# Dynamo graph ConverGeometryToRevitFamily.dyn "00_ConverToRevitFamily" (Dynamo 2.3.0.5885)
# packages: spring nodes 204.1.0

# note: The script converts all the sat solids to individual families. If multiple geometries are desired to be a single family the geometry should be joined.
file_path = Filename("C:\Users\omer_\Desktop\ThinkParametric\Basic Interoperability Rhino & Revit_Assets\00_MyFiles\Boxes.sat")
file_from_path = FileObject(path=file_path)
importFromSAT = Geometry.ImportFromSAT(file=file_from_path)
ꟿ_familytemplatepaths = Custom[ꟿ FamilyTemplatePaths.CommonPaths]()  # package spring nodes; Fetches the default family template paths
# note: There should be a family name for each
# geometry to be converted.
code_block = CodeBlock { ["Solid1", "Solid2"]; }
categories = Categories("OST_GenericModel")
# note: Springs Nodes package
ꟿ_familyinstance_bygeometry = Custom[ꟿ FamilyInstance.ByGeometry](geometry=importFromSAT, familyTemplatePath=ꟿ_familytemplatepaths.GenericModelTemplate, familyName=code_block, category=categories)  # package spring nodes; You must provide a valid family template path that will be used for all input geometry objects. The project units(and not the templates) will be used to determine the size of the output geometry. The provided category will be used only if the family template supports it. If not, the default template category will be used instead. Likewise, the family material(provided as a string) will be set only if a material with that name exists in the template. If not, the default material will be used instead ("By Category"). For void cuts, the material settings will be ignored. The Subcategory name is an optional input. If you'd like to skip assigning a Subcategory to any new instance, simply use null. The node expects a unique family name for each geometry object. The rest of the input lists will be processed as if the node lacing is set to longest.
